# Grasshopper definition unnamed.gh (Grasshopper 1.0.6)
# Copyright: Benson Architecture and Design

geometry = Geometry(<brep referenced from the Rhino model>)
unit_z = UnitZ(Factor=1)
contour = Contour(Shape=geometry, Point=Point(0, 0, 0), Direction=unit_z, Distance=Slider(27, range=0..100))
surface = Surface(contour)
area = Area(Geometry=surface)  # -> Area, Centroid
round = Round(Number=area.Area)  # -> Nearest, Floor, Ceiling
concatenate = Concatenate(FragmentA=round.Floor, FragmentB=" m2")
bounds = Bounds(Numbers=flatten(area.Area))
deconstruct_domain = DeconstructDomain(Domain=bounds)  # -> Start, End
text_tag_3d = TextTag3D(
    Location=area.Centroid,
    Text=concatenate,
    Size=Slider(5, range=0..5),
    Colour=ColourSwatch(SwatchColor=RGB(255, 255, 255)),
    Justification=2)
gradient = Gradient(
    LowerLimit=deconstruct_domain.Start,
    UpperLimit=deconstruct_domain.End,
    Parameter=flatten(area.Area),
    stops=[0.025: RGB(255, 0, 0), 0.5: RGB(255, 255, 0), 0.965: RGB(0, 128, 0)])
custom_preview = CustomPreview(Geometry=flatten(surface), Material=gradient)
